# Dynamo graph importSmokeDetectorData.dyn (Dynamo 1.3.3.4111)

categories = Categories("Rooms")
all_elements_of_category = ElementsOfCategory(categories)
file_path = Filename(".\data-pred.csv")
fromPath = FileObject(file_path)  # "File.FromPath"
code_block = CodeBlock { "data-pred"; true; }
readFromFile = Excel.ReadFromFile(file=fromPath, sheetName=code_block.out0, readAsStrings=code_block.out1)
restOfItems = List.RestOfItems(readFromFile)
transpose = List.Transpose(restOfItems)
code_block_2 = CodeBlock { 5; }
getItemAtIndex = List.GetItemAtIndex(list=transpose, index=code_block_2)
parameterByName = Parameter.ParameterByName(element=all_elements_of_category, name=getItemAtIndex)
family_types = FamilyTypes("Smoke Detector:Plain")
code_block_3 = CodeBlock { 1; 5; }
getItemAtIndex_2 = List.GetItemAtIndex(list=transpose, index=code_block_3.out1)
code_block_4 = CodeBlock { 3; }
getItemAtIndex_3 = List.GetItemAtIndex(list=transpose, index=code_block_4)
getItemAtIndex_4 = List.GetItemAtIndex(list=transpose, index=code_block_3.out0)
python_script = Python(IN[0]=getItemAtIndex_2, IN[1]=getItemAtIndex_3, IN[2]=getItemAtIndex_4)
# ---------- python_script.python (15 lines) ----------
import clr
clr.AddReference('ProtoGeometry')
from Autodesk.DesignScript.Geometry import *
#The inputs to this node will be stored as a list in the IN variables.
dataEnteringNode = IN

#Assign your output to the OUT variable.

li=[]
for i,j,k in zip(IN[0],IN[1],IN[2]):
	
	if i=='1' and k=='Yes':
		li.append(j)
	
OUT = li
# ----------------------------------------
categories_2 = Categories("Rooms")
all_elements_of_category_2 = ElementsOfCategory(categories_2)
code_block_5 = CodeBlock { "Name"; }
getParameterValueByName = Element.GetParameterValueByName(element=all_elements_of_category_2, parameterName=code_block_5)
python_script_2 = Python(IN[0]=python_script, IN[1]=getParameterValueByName)
# ---------- python_script_2.python (28 lines) ----------
import clr
clr.AddReference('ProtoGeometry')
from Autodesk.DesignScript.Geometry import *
#The inputs to this node will be stored as a list in the IN variables.
dataEnteringNode = IN

#Assign your output to the OUT variable.
counter=0
new_list=[]

def listToStrings(s):
	str1=" "
	return(str1.join(s))

test_li=[]

for i in IN[1]:
	
	for ii in IN[0]:
		ii=ii.split()
		#ii.pop(0)
		ii=listToStrings(ii)
		#ii=ii[:-1]
		if i==ii:
			new_list.append(counter)
	counter+=1
out_list=list(dict.fromkeys(new_list))
OUT = out_list
# ----------------------------------------
python_script_3 = Python(IN[0]=python_script_2, IN[1]=all_elements_of_category_2)
# ---------- python_script_3.python (14 lines) ----------
import clr
clr.AddReference('ProtoGeometry')
from Autodesk.DesignScript.Geometry import *
#The inputs to this node will be stored as a list in the IN variables.
dataEnteringNode = IN

#Assign your output to the OUT variable.

out_list=[]

for i in IN[0]:
	out_list.append(IN[1][i])

OUT = out_list
# ----------------------------------------
location = Room.Location(python_script_3)
X = Point.X(location)
Y = Point.Y(location)
height = Room.Height(python_script_3)
byCoordinates = Point.ByCoordinates(x=X, y=Y, z=height)
byPoint = FamilyInstance.ByPoint(familyType=family_types, point=byCoordinates)
watch = Watch(python_script)
watch_2 = Watch()  # unwired: arg0
watch_3 = Watch(transpose)
